# Grasshopper definition call_from_hops.gh (Grasshopper 1.0.7)
# plug-ins: Hops

pt = Point(Point(-25, 0, 0))
cir = Circle(Plane=pt, Radius=Slider(11, range=10..20))
hops = Hops(
    Curve=cir,
    T=Slider(34, range=20..40),
    CacheResultsInMemory=True,
    CacheSolveResults=True,
    RemoteDefinitionLocation="http://127.0.0.1:5000/pointat",
    RemoteSolveVersion=(0, 1, 0),
    ShowInput_Enabled=False,
    ShowInput_Path=False,
    SynchronousSolve=True)
pt_2 = Point(hops)
